# Grasshopper definition daylight_regulation.gh (Grasshopper 1.0.7)
# plug-ins: Human

# ---- group: daylight_regulation
# True => Loft
# Bearing
# False => Extrude
point = Point([Point(222.5421358, 47.01734079, 0), Point(213.2045941, -15.33886839, 0), Point(257.3097545, -39.95396391, 0), Point(334.1151979, -27.13567147, 0), Point(376.0075342, -37.04234495, 0), Point(384.3291942, -5.642430478, 0), Point(332.8323505, 29.97104033, 0), Point(276.2375964, 18.27708034, 0), Point(290.1122428, 53.87279251, 0)])
polyline = PolyLine(Vertices=point, Closed=True)
type = BooleanToggle(True)
ghpython_script = GhPythonScript(site_polyline=polyline, floor_height="4.3", floor_count="15", cutting_type=type)  # -> out, ceiling_polylines, mass; inputs site_polyline: Curve, floor_count: Int32, cutting_type: Boolean
# ---------- ghpython_script: Python ----------
import rhinoscriptsyntax as rs
import ghpythonlib.components as gh


if __name__ == "__main__":
    
    ceiling_polylines = []
    criterion = 9
    for i in range(1, floor_count+1):
        ceiling_height = i*floor_height
        distance = 1.5
        
        if ceiling_height > criterion:
            distance = ceiling_height / 2
        
        s_vector = gh.ConstructPoint(0, -distance, 0)
        moved_polyline = gh.Move(site_polyline, s_vector)[0]
        
        ceiling_polyline = gh.RegionIntersection(moved_polyline, site_polyline)
        z_vector = gh.ConstructPoint(0, 0, ceiling_height)
        
        ceiling_polyline = gh.Move(ceiling_polyline, z_vector)[0]
        ceiling_polylines.append(ceiling_polyline)
    
    if cutting_type == True:
        z_vector = gh.ConstructPoint(0, 0, -floor_height)
        first_floor = gh.Move(ceiling_polylines[0], z_vector)[0]
        
        ceiling_polylines.insert(0, first_floor)
        mass = []
        for i in range(len(ceiling_polylines)-1):
            loft_polyline = [ceiling_polylines[i], ceiling_polylines[i+1]]
            wall = rs.AddLoftSrf(loft_polyline)
            
            converted_wall = rs.coercebrep(wall)
            floor = gh.CapHoles(converted_wall)
            mass.append(floor)
        
        
    else:
        mass = []
        for ceiling in ceiling_polylines:
            z_vector = gh.ConstructPoint(0, 0, -floor_height)
            
            wall = gh.Extrude(ceiling, z_vector)
            floor = gh.CapHoles(wall)
            mass.append(floor)
# ---------- end ghpython_script ----------
line = Line([Line((386.0565098, 61.98957928, 0), (368.8791313, 61.98957928, 0)), Line((368.8791313, 61.98957928, 0), (377.657282, 78.01801994, 0)), Line((377.657282, 78.01801994, 0), (377.657282, 46.65758695, 0))])
curve = Curve(ghpython_script.ceiling_polylines)
brep = Brep(ghpython_script.mass)
custom_preview_lineweights = CustomPreviewLineweights(Geometry=[polyline, line], Shader=ColourSwatch(SwatchColor=RGB(0, 0, 0)), Thickness=2, Absolute=False)
