# Grasshopper definition fractal_tree.gh (Grasshopper 1.0.7)

# ---- group: Recursive 2d fractal tree
ghpython_script = GhPythonScript()  # -> out, fractal_tree
# ---------- ghpython_script: Python ----------
import math
import Rhino.Geometry as rg


def to_radians(angle):
    return math.pi * angle
    
def draw_tree(x1, y1, branch_angle, tree_length, base_angle, scale, depth, fractal_tree):
    if depth >= 0:
        rad = to_radians(base_angle)
        x2 = x1 + math.cos(rad) * tree_length
        y2 = y1 + math.sin(rad) * tree_length
        
        p1 = rg.Point3d(y1, 0, x1)
        p2 = rg.Point3d(y2, 0, x2)
        fractal_tree.append(rg.Line(p1, p2))
        
        draw_tree(x2, y2, branch_angle, tree_length*scale, base_angle+branch_angle, scale, depth-1, fractal_tree)
        draw_tree(x2, y2, branch_angle, tree_length*scale, base_angle-branch_angle, scale, depth-1, fractal_tree)
        
if __name__ == "__main__":
    branch_angle = 0.12
    tree_length = 8
    base_angle = 0
    scale = 0.7
    depth = 7
    
    fractal_tree = []
    origin_x, origin_y = 0, 0
    
    draw_tree(origin_x,origin_y,branch_angle, tree_length, base_angle, scale, depth, fractal_tree)
# ---------- end ghpython_script ----------

# ---- group: Loop 2d fractal tree
ghpython_script_2 = GhPythonScript()  # -> out, fractal_tree_branches
# ---------- ghpython_script_2: Python ----------
import Rhino.Geometry as rg
import ghpythonlib.components as gh
import math

class FractalTree2D:
    def __init__(self, depth):
        self.depth = depth  # int
        self.fractal_tree_branches = []  # List[Rhino.Geometry.Line]
        self._generate()
        
    def _generate(self):
        for d in range(self.depth):
            # generate first branch
            if d == 0:
                base_branch = rg.Line(ORIGIN, ORIGIN + VECTOR_Z * BRANCH_LENGTH)
                self.fractal_tree_branches.append(base_branch)
                self.fractal_tree_branches.extend(self._divide_target_branch(base_branch))
                
                if self.depth == 1:
                    break
                    
            sub_branches = self.fractal_tree_branches[-2 ** d * 2:]
            
            for sub_branch in sub_branches:
                self.fractal_tree_branches.extend(self._divide_target_branch(sub_branch))
                
    def _divide_target_branch(self, target_branch):
                
        target_branch_last_vertex = target_branch.PointAt(1)
        
        reduced_target_branch= rg.Line(
                                      target_branch_last_vertex,
                                      target_branch.PointAt(1 - SUB_BRANCH_RATIO)
                                      )
        
        rotated_reduced_target_branch_1 = gh.Rotate(
                                                  reduced_target_branch, 
                                                  ANGLE * math.pi, 
                                                  gh.XZPlane(target_branch_last_vertex)
                                                 ).geometry
        
        rotated_reduced_target_branch_2 = gh.Rotate(
                                                  reduced_target_branch, 
                                                  (ANGLE + (1 - ANGLE) * 2) * math.pi, 
                                                  gh.XZPlane(target_branch_last_vertex)
                                                 ).geometry
        
        return rotated_reduced_target_branch_1, rotated_reduced_target_branch_2

ORIGIN = rg.Point3d(30, 0, 0)
VECTOR_Z = rg.Point3d(0, 0, 1)
SUB_BRANCH_RATIO = 0.7
BRANCH_LENGTH = 8
ANGLE = 0.88
DEPTH = 6

if __name__ == "__main__":
    # depth is iteration count
    fractal_tree_2d = FractalTree2D(depth=DEPTH)
    fractal_tree_branches = fractal_tree_2d.fractal_tree_branches
# ---------- end ghpython_script_2 ----------

# ---- group: Fractal christmas tree
ghpython_script_3 = GhPythonScript()  # -> out, fractal_christmass_tree_branches, trunk, TEST
# ---------- ghpython_script_3: Python ----------
import Rhino.Geometry as rg
import ghpythonlib.components as gh
import ghpythonlib.treehelpers as gt
import math



class FractalChristmassTree:
    def __init__(self, depth):
        self.depth = depth                          # int
        self.fractal_christmass_tree_branches = []  # List[Rhino.Geometry.Line]
        self.fractal_christmass_tree_main_branches = []
        
        self._generate()
        
    def _generate(self):
        """generate fractal_christmass_tree"""
        
        if self.depth > 0:
            height = 0
            for i in reversed(range(TREE_ITERATION_COUNT)):
                circle_origin = ORIGIN + rg.Point3d(0, 0, height)
                
                circle_radius = CIRCLE_RADIUS * CIRCLE_RATIO * i
                circle = rg.Circle(circle_origin, circle_radius)
                
                height += HEIGHT_INTERVAL
                
                if circle.Radius != 0 and i != TREE_ITERATION_COUNT - 1:
                    
                    divided_circle_points = gh.DivideCurve(circle, CIRCLE_DIVIDE_COUNT + i, False).points
                    main_branches = gh.Line(
                                     circle_origin + rg.Point3d(0, 0, HEIGHT_INTERVAL), 
                                     divided_circle_points
                                    )
                                    
                    self.fractal_christmass_tree_branches.extend(main_branches)
                    self.fractal_christmass_tree_main_branches.extend(main_branches)
                    
                    for main_branch in main_branches:
                        # 1st depth branches per main branches
                        sub_branches = self._get_sub_branches(main_branch)
                        self.fractal_christmass_tree_branches.extend(sub_branches)
                        
                        if self.depth > 1:
                            # greater than 2nd depth branches per sub branches
                            for d in range(self.depth - 1):
                                sub_branches = self._get_depth_sub_branches(sub_branches)
                                self.fractal_christmass_tree_branches.extend(sub_branches)
        
    def _get_divided_target_branch(self, target_branch):
        """get target branch's sub branches"""
        
        target_branch_aligned_surface = gh.Extrude(target_branch, VECTOR_Z)
        target_branch_aligned_plane = gh.PlaneOrigin(
                                                     target_branch_aligned_surface,
                                                     gh.Area(target_branch_aligned_surface).centroid
                                                    )
                                                    
        target_branch_origin = target_branch.PointAt(0)
        target_branch_aligned_plane.Origin = target_branch_origin
        
        sub_brnach_1_base_segment = gh.Rotate(
                                              target_branch, 
                                              math.pi * SUB_BRANCH_ANGLE, 
                                              target_branch_aligned_plane
                                             ).geometry
                                                
        sub_brnach_1_rotated_segment = gh.Rotate(
                                                 sub_brnach_1_base_segment, 
                                                 math.pi * SUB_BRANCH_ANGLE, 
                                                 target_branch_origin,
                                                ).geometry
        sub_brnach_2_rotated_segment = gh.Rotate(
                                                 sub_brnach_1_base_segment, 
                                                 math.pi * -SUB_BRANCH_ANGLE, 
                                                 target_branch_origin,
                                                ).geometry
        
        return [sub_brnach_1_rotated_segment, sub_brnach_2_rotated_segment]

    def _get_sub_branches(self, target_branch):
        """get target branch's all sub branches"""
        
        divided_target_branch_points = gh.DivideCurve(target_branch, SUB_BRANCH_DIVIDE_COUNT, False).points
        shifted_divided_target_branch_points = divided_target_branch_points[1:] + divided_target_branch_points[:1]
        
        divided_segments = [
                            rg.Line(d, s) for d, s in zip(
                                                          divided_target_branch_points[:-1],
                                                          shifted_divided_target_branch_points[:-1]
                                                         )
                           ]
    
        sub_branch_1_segments = self._get_divided_target_branch(divided_segments[1])
        sub_branch_2_segments = self._get_divided_target_branch(divided_segments[2])
        
        return sub_branch_1_segments + sub_branch_2_segments
        
        
    def _get_depth_sub_branches(self, sub_branches):
        """get sub branches's sub branches"""
        
        all_divided_sub_branches = []
        for sub_branch in sub_branches:
            divided_sub_branches = self._get_sub_branches(sub_branch)
            all_divided_sub_branches += divided_sub_branches
            
        return all_divided_sub_branches


ORIGIN = rg.Point3d(0, 0, 0)
VECTOR_Z = rg.Point3d(0, 0, 1)

CIRCLE_RATIO = 0.2
CIRCLE_RADIUS = 10
CIRCLE_DIVIDE_COUNT = 10
TREE_ITERATION_COUNT = 8
HEIGHT_INTERVAL = 5

DEPTH = 3
SUB_BRANCH_LOCATION = 0.333
SUB_BRANCH_DIVIDE_COUNT = 3
SUB_BRANCH_ANGLE = -0.2


if __name__ == "__main__":
    fractal_christmass_tree = FractalChristmassTree(depth=DEPTH)
    trunk = rg.Line(ORIGIN, ORIGIN + rg.Point3d(0, 0, TREE_ITERATION_COUNT * HEIGHT_INTERVAL - 5))
    
    fractal_christmass_tree_branches = fractal_christmass_tree.fractal_christmass_tree_branches
    
    TEST = fractal_christmass_tree.fractal_christmass_tree_main_branches
# ---------- end ghpython_script_3 ----------

# ----
ghpython_script_4 = GhPythonScript()  # -> out, colors
# ---------- ghpython_script_4: Python ----------
from System.Drawing import Color
import random

colors = []
for _ in range(27545):
    
    r = random.randint(0, 255)
    g = random.randint(0, 255)
    b = random.randint(0, 255)
    a = ( r + g + b ) / 3
    
    
    color = Color.FromArgb(a, r, g, b)
    colors.append(color)
# ---------- end ghpython_script_4 ----------
