# Grasshopper definition mass_generator.gh (Grasshopper 1.0.7)

file_path = FilePath("C:\BACKUP\Playdata\202105_lab\02.git\toyProject\mass_generator\data\teheran.geojson")
ghpython_script = GhPythonScript(file_path=file_path)  # -> out, centroids, buildings, min_height, max_height, heights, heights_text, min_regist_code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
# ---------- ghpython_script: Python ----------
import Rhino.Geometry as rg
import rhinoscriptsyntax as rs
from collections import Counter
import json


class Data:
    def __init__(self, file_path):
        self.file_path = file_path
        self.data_features = self.read_data()['features']
        
    def read_data(self):
        with open(self.file_path, 'r') as data:
            convert_data = json.load(data)
        return convert_data
        
    def read_columns(self):
        return self.read_data().keys()
        
    def read_geometry(self):
        geometry_data = []
        for data in self.data_features:
            geometries = data['geometry']['coordinates'][0][0]
            geometry_data.append(geometries)
        return geometry_data
        
    def read_information(self):
        information_data = []
        for data in self.data_features:
            properties = data['properties']
            information_data.append(properties)
        return information_data
        
    def calculate_height(self):
        building_information = self.read_information()
        building_heights = []
        floor_height = 4
        for information in building_information:
            height_information = information['HEIGHT']
            floor_information = information['GRND_FLR']
            
            building_height = max(height_information, floor_information * floor_height)
            building_heights.append(building_height)
        return building_heights
        
    def preprocess_information(self, keyword):
        postprocess = []
        for data in self.read_information():
            target_data = data[keyword]
            if target_data is not None:
                postprocess.append(int(target_data))
            else:
                postprocess.append(0)
        return postprocess


class Generator(Data):
    def __init__(self, path):
        Data.__init__(self, path)
        
    def generate_polylines(self):
        polylines = []
        coordinates = self.read_geometry()
        for coords in coordinates:
            points = []
            
            for c in coords:
                x, y, z = c[0], c[1], 0
                point = rs.AddPoint(x, y, z)
                points.append(point)
            
            polyline = rs.AddPolyline(points)
            polylines.append(polyline)
        return polylines
        
    def generate_centroids(self):
        polylines = self.generate_polylines()
        centroids = []
        for polyline in polylines:
            centroid = rs.CurveAreaCentroid(polyline)[0]
            centroids.append(centroid)
        return centroids
        
    def extrude_polylines(self):
        building_polylines = self.generate_polylines()
        building_heights = self.calculate_height()
        
        buildings = []
        for i, polyline in enumerate(building_polylines):
            z = building_heights[i]
            path = rs.AddLine(rs.AddPoint(0,0,0), rs.AddPoint(0,0,z))
            building = rs.ExtrudeCurve(polyline, path)
            
            if building is not None:
                rs.CapPlanarHoles(building)
            
            buildings.append(building)
        return buildings



if __name__ == "__main__":
    data_object = Generator(file_path)
    buildings = data_object.extrude_polylines()
    centroids = data_object.generate_centroids()
    
    heights = data_object.calculate_height()
    min_height = min(heights)
    max_height = max(heights)
    
    regist_keyword = 'REGIST_DAY'
    regist_codes = data_object.preprocess_information(regist_keyword)
    min_regist_code = min(regist_codes)
    max_regist_code = max(regist_codes)
    
    structure_keyword = 'STRCT_CD'
    structure_codes = data_object.preprocess_information(structure_keyword)
    min_structure = min(structure_codes)
    max_structure = max(structure_codes)

    usability_keyword = 'USABILITY'
    usability_codes = data_object.preprocess_information(usability_keyword)
    min_usability = min(usability_codes)
    max_usability = max(usability_codes)
    
    scaled_usability = list(map(lambda x: int(100 * ((x-min_usability) / max_usability - min_usability)), usability_codes))
    min_scaled_usability = min(scaled_usability)
    max_scaled_usability = max(scaled_usability)
    
    heights_text = heights
    regist_text = regist_codes
    structure_text = structure_codes
    usability_text = usability_codes
# ---------- end ghpython_script ----------

# ---- group: Heights
gradient = Gradient(
    LowerLimit=ghpython_script.min_height,
    UpperLimit=ghpython_script.max_height,
    Parameter=ghpython_script.heights,
    stops=[0.0262: RGBA(255, 255, 255, 43), 0.626: RGB(255, 3, 3)])
text = Text(ghpython_script.heights_text)

# ---- group: Regist Day
gradient_2 = Gradient(
    LowerLimit=ghpython_script.min_regist_code,
    UpperLimit=ghpython_script.max_regist_code,
    Parameter=ghpython_script.regist_codes,
    stops=[0: RGB(0, 0, 0), 0.547: RGB(196, 196, 196), 0.881: RGBA(255, 255, 255, 107)])
text_2 = Text(ghpython_script.regist_text)

# ---- group: Structure Code
gradient_3 = Gradient(
    LowerLimit=ghpython_script.min_structure,
    UpperLimit=ghpython_script.max_structure,
    Parameter=ghpython_script.structure_codes,
    stops=[0.11: RGB(192, 0, 0), 0.182: RGB(0, 255, 0), 0.212: RGB(255, 255, 255), 0.313: RGB(255, 128, 0), 0.325: RGB(255, 0, 255), 0.335: RGB(192, 192, 255), 0.391: RGB(192, 192, 0), 0.415: RGB(0, 0, 255), 0.424: RGB(128, 255, 255), 0.511: RGB(0, 128, 0)])
text_3 = Text(ghpython_script.structure_text)

# ---- group: Usability
gradient_4 = Gradient(
    LowerLimit=ghpython_script.min_scaled_usability,
    UpperLimit=ghpython_script.max_scaled_usability,
    Parameter=ghpython_script.scaled_usability,
    stops=[0: RGB(255, 0, 0), 0.0545: RGB(0, 255, 255), 0.102: RGB(0, 255, 0), 0.153: RGB(255, 128, 0), 0.204: RGB(255, 0, 255), 0.255: RGB(32, 178, 170), 0.305: RGB(184, 134, 11), 0.355: RGB(25, 25, 112), 0.453: RGB(135, 206, 250), 0.503: RGB(160, 82, 45)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])
text_4 = Text(ghpython_script.usability_text)

# ---- group: visualization
unit_z = UnitZ(Factor=Slider(514, range=0..1000))
move = Move(Geometry=ghpython_script.centroids, Motion=unit_z)  # -> Geometry, Transform
geometry = Geometry(ghpython_script.buildings)
text_tag_3d = TextTag3D(Location=move.Geometry, Text=text, Size=7, Justification=7)
custom_preview = CustomPreview(Geometry=geometry, Material=gradient)
