# Grasshopper definition minimal_surface.gh (Grasshopper 1.0.7)
# plug-ins: Human

number_slider = Slider(50, range=0..100)

number_slider_2 = Slider(0.476, range=0..1)
square_root = SquareRoot(Value="2")
square_root_2 = SquareRoot(Value="3")
subtraction = Subtraction(A=1, B=number_slider_2)
division = Division(A=2, B=square_root_2)
multiplication = Multiplication(A=number_slider_2, B=division)
multiplication_2 = Multiplication(A=square_root, B=subtraction)
subtraction_2 = Subtraction(A=1, B=multiplication)
multiplication_3 = Multiplication(A=subtraction_2, B=square_root_2)
subtraction_3 = Subtraction(A=1, B=multiplication_3)

domain_box = DomainBox(Base=PlaneXY(0, 0, 0), X=number_slider, Y=number_slider, Z=number_slider)
deconstruct_brep = DeconstructBrep(Brep=domain_box)  # -> Faces, Edges, Vertices
list_item = ListItem(List=deconstruct_brep.Vertices, Index=2, Wrap=True)
list_item_2 = ListItem(List=deconstruct_brep.Vertices, Index=1, Wrap=True)
list_item_3 = ListItem(List=deconstruct_brep.Vertices, Index=5, Wrap=True)
list_item_4 = ListItem(List=deconstruct_brep.Vertices, Index=4, Wrap=True)
line = Line(StartPoint=list_item, EndPoint=list_item_4)
line_2 = Line(StartPoint=list_item_2, EndPoint=list_item_4)
curve_middle = CurveMiddle(Curve=line)
curve_middle_2 = CurveMiddle(Curve=line_2)

# ---- group: Pt Inside
point = Point(curve_middle)

# ---- group: Pt Mid
point_2 = Point(curve_middle_2)

# ---- group: Pt B
point_3 = Point(list_item_3)

# ---- group: Pt A
point_4 = Point(list_item_4)

# ---- group: box frame
curve = Curve(deconstruct_brep.Edges)

# ----
subtraction_4 = Subtraction(A=point_2, B=point)
plane_3pt = Plane3Pt(PointA=point_2, PointB=point_4, PointC=point_3)
line_3 = Line(StartPoint=point_4, EndPoint=point_2)
line_4 = Line(StartPoint=point_3, EndPoint=point_4)
line_5 = Line(StartPoint=point_2, EndPoint=point)
line_6 = Line(StartPoint=point_3, EndPoint=point)
evaluate_length = EvaluateLength(Curve=line_5, Length=subtraction_3, Normalized=True)  # -> Point, Tangent, Parameter
evaluate_length_2 = EvaluateLength(Curve=line_6, Length=multiplication_2, Normalized=True)  # -> Point, Tangent, Parameter
evaluate_length_3 = EvaluateLength(Curve=line_3, Length=multiplication_2, Normalized=True)  # -> Point, Tangent, Parameter
evaluate_length_4 = EvaluateLength(Curve=line_4, Length=number_slider_2, Normalized=True)  # -> Point, Tangent, Parameter
vector_2pt = Vector2Pt(PointA=point_2, PointB=point_4, Unitize=False)  # -> Vector, Length
vector_2pt_2 = Vector2Pt(PointA=point, PointB=point_2, Unitize=False)  # -> Vector, Length
plane_3pt_2 = Plane3Pt(PointA=point_2, PointB=point_4, PointC=point)
vector_2pt_3 = Vector2Pt(PointA=point_3, PointB=point_4, Unitize=False)  # -> Vector, Length
plane_3pt_3 = Plane3Pt(PointA=point_2, PointB=point_3, PointC=point)
plane_3pt_4 = Plane3Pt(PointA=point_4, PointB=point_3, PointC=point)
vector_2pt_4 = Vector2Pt(PointA=point_3, PointB=point_4, Unitize=False)  # -> Vector, Length
vector_2pt_5 = Vector2Pt(PointA=point, PointB=point_2, Unitize=False)  # -> Vector, Length
pi = Pi(Factor=1)
pi_2 = Pi(Factor=1)
plane_origin = PlaneOrigin(Base=plane_3pt_2, Origin=evaluate_length_3.Point)
plane_origin_2 = PlaneOrigin(Base=plane_3pt_3, Origin=evaluate_length.Point)
plane_origin_3 = PlaneOrigin(Base=plane_3pt, Origin=evaluate_length_4.Point)
plane_origin_4 = PlaneOrigin(Base=plane_3pt_4, Origin=evaluate_length_2.Point)
pi_3 = Pi(Factor=1)
number_slider_3 = Slider(50, range=0..100)
division_2 = Division(A=pi, B=-2)
division_3 = Division(A=pi_2, B=2)
pi_4 = Pi(Factor=1)
division_4 = Division(A=pi_3, B=-2)
pi_5 = Pi(Factor=1)
rotate = Rotate(Vector=vector_2pt_2.Vector, Axis=plane_origin_2, Angle=division_3)
rotate_2 = Rotate(Vector=vector_2pt_4.Vector, Axis=plane_origin_4, Angle=division_4)
division_5 = Division(A=pi_4, B=2)
division_6 = Division(A=pi_5, B=-2)
domain_box_2 = DomainBox(Base="-100,0,0", X=number_slider_3, Y=number_slider_3, Z=number_slider_3)

# ---- group: batwing_minimal_surface
ghpython_script = GhPythonScript(slider=number_slider_2)  # -> out, base_edges, point_inside, point_mid, line_1, line_2, line_3, line_4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
# ---------- ghpython_script: Python ----------
import math
import random
import Rhino.Geometry as rg
import Rhino.RhinoDoc as rc
import rhinoscriptsyntax as rs
import ghpythonlib.components as gh


def subtraction(a, b):
    return a-b

def multiplication(a, b):
    return a*b

def division(a, b):
    return a/b

def square_root(x):
    return math.sqrt(x)

def base_boundary(origin, size):
    x, y, z = origin[0], origin[1], origin[2]
    origin_point = gh.ConstructPoint(x, y, z)
    boundary_box = gh.DomainBox(origin_point, size, size, size)
    return boundary_box

def brep_elements(brep):
    _, edges, vertices = gh.DeconstructBrep(brep)
    return edges, vertices

def brep_centroid(brep):
    _, centroid = gh.Volume(brep)
    return centroid

def line_generate(pt1, pt2):
    return gh.Line(pt1, pt2)

def line_evaluate(line, place):
    return gh.EvaluateLength(line, place, True)[0]

def twopoint_midpoint(pt1, pt2):
    x = (pt1[0]+pt2[0]) * 0.5
    y = (pt1[1]+pt2[1]) * 0.5
    z = (pt1[2]+pt2[2]) * 0.5
    midpoint = gh.ConstructPoint(x,y,z)
    return midpoint

def plane_generate(pt1, pt2, pt3):
    return gh.Plane3Pt(pt1, pt2, pt3)

def plane_origin(plane, origin):
    return gh.PlaneOrigin(plane, origin)

def vector_twopoint(pt1, pt2):
    return pt2 - pt1

def arc_generate(pt1, pt2, vector):
    return gh.ArcSED(pt1, pt2, vector)[0]

def surface_generate(edge_1, edge_2, edge_3, edge_4):
    return gh.EdgeSurface(edge_1, edge_2, edge_3, edge_4)

def surface_mirror(surface, plane):
    return gh.Mirror(surface, plane)[0]


if __name__ == "__main__":
    # 1.  set parameter
    root_2 = square_root(2)
    root_3 = square_root(3)
    temp_1 = subtraction(1, slider)
    temp_2 = division(2, root_3)
    
    parameter_a = slider
    parameter_b = multiplication(root_2, temp_1)
    parameter_c = multiplication(slider, temp_2)
    parameter_d = subtraction(1, parameter_c)
    parameter_d = multiplication(parameter_d, root_3)
    parameter_d = subtraction(1, parameter_d)
    
    
    # 2. minimal surface base boundary
    base = base_boundary([-100,0,0], 50)
    
    
    # 3. base point & line for minimal surface generate
    base_edges, base_vertices = brep_elements(base)
    point_a = base_vertices[4]
    point_b = base_vertices[5]
    point_mid = twopoint_midpoint(base_vertices[1], base_vertices[4])
    point_inside = brep_centroid(base)
    
    line_1 = line_generate(point_a, point_mid)
    line_2 = line_generate(point_mid, point_inside)
    line_3 = line_generate(point_b, point_inside)
    line_4 = base_edges[4]
    line_1_pt = line_evaluate(line_1, parameter_b)
    line_2_pt = line_evaluate(line_2, parameter_d)
    line_3_pt = line_evaluate(line_3, parameter_b)
    line_4_pt = line_evaluate(line_4, parameter_a)
    
    
    # 4. minimal surface edges generate
    edge_1_vector = vector_twopoint(line_4_pt, point_mid)
    edge_2_vector = vector_twopoint(line_4_pt, point_inside)
    edge_3_vector = vector_twopoint(point_mid, point_b)
    edge_4_vector = vector_twopoint(point_mid, point_a)
    edge_1 = arc_generate(line_4_pt, line_1_pt, edge_1_vector)
    edge_2 = arc_generate(line_4_pt, line_3_pt, edge_2_vector)
    edge_3 = arc_generate(line_2_pt, line_3_pt, edge_3_vector)
    edge_4 = arc_generate(line_2_pt, line_1_pt, edge_4_vector)
    
    minimal_surface = surface_generate(edge_1, edge_2, edge_3, edge_4)
    
    # 5. surface mirroring
    mirror_plane_1 = plane_generate(base_vertices[0], base_vertices[2], base_vertices[4])
    mirror_plane_2 = plane_generate(base_vertices[1], base_vertices[3], base_vertices[5])
    a = surface_mirror(minimal_surface, mirror_plane_1)
# ---------- end ghpython_script ----------
point_5 = Point(Point(-75.77826902, -66.77995164, 27.76274725))
vector_display = VectorDisplay(
    Anchor=point_5,
    Vector=[ghpython_script.edge_1_vector, ghpython_script.edge_2_vector, ghpython_script.edge_3_vector, ghpython_script.edge_4_vector])
custom_preview_lineweights = CustomPreviewLineweights(
    Geometry=[ghpython_script.base_edges, ghpython_script.minimal_surface, ghpython_script.line_1, ghpython_script.line_1_pt, ghpython_script.line_2_pt, ghpython_script.line_3_pt, ghpython_script.line_4_pt, ghpython_script.line_2, ghpython_script.line_3, ghpython_script.a],
    Shader=ColourSwatch(SwatchColor=RGB(255, 0, 161)),
    Thickness=Slider(2, range=0..10),
    Absolute=False)
text_tag = TextTag(Location=point_5, Text="vector display")

# ----
panel = Panel(plane_origin_3)
rotate_3 = Rotate(Vector=vector_2pt_3.Vector, Axis=plane_origin_3, Angle=division_2)
rotate_4 = Rotate(Vector=vector_2pt.Vector, Axis=plane_origin, Angle=division_5)
rotate_5 = Rotate(Vector=vector_2pt_5.Vector, Axis=plane_origin, Angle=division_6)
deconstruct_brep_2 = DeconstructBrep(Brep=domain_box_2)  # -> Faces, Edges, Vertices
arc_sed = ArcSED(Start=evaluate_length_4.Point, End=evaluate_length_2.Point, Direction=rotate_2)  # -> Arc, Plane, Radius
list_item_5 = ListItem(List=deconstruct_brep_2.Vertices, Index=4, Wrap=True)
list_item_6 = ListItem(List=deconstruct_brep_2.Vertices, Index=2, Wrap=True)
list_item_7 = ListItem(List=deconstruct_brep_2.Vertices, Index=0, Wrap=True)
panel_2 = Panel([rotate_4, rotate_5])
arc_sed_2 = ArcSED(Start=evaluate_length.Point, End=evaluate_length_2.Point, Direction=rotate)  # -> Arc, Plane, Radius
arc_sed_3 = ArcSED(Start=evaluate_length_4.Point, End=evaluate_length_3.Point, Direction=rotate_3)  # -> Arc, Plane, Radius
plane_3pt_5 = Plane3Pt(PointA=list_item_7, PointB=list_item_6, PointC=list_item_5)
biarc = BiArc(
    StartPoint=evaluate_length_3.Point,
    StartTangent=rotate_4,
    EndPoint=evaluate_length.Point,
    EndTangent=rotate_5,
    Ratio=0.5)  # -> FirstArc, SecondArc, BiArc
edge_surface = EdgeSurface(CurveA=biarc.BiArc, CurveB=arc_sed_2.Arc, CurveC=arc_sed.Arc, CurveD=arc_sed_3.Arc)
curve_2 = Curve(biarc.SecondArc)
mirror = Mirror(Geometry=ghpython_script.minimal_surface, Plane=plane_3pt_5)  # -> Geometry, Transform
