# Grasshopper definition path_finder.gh (Grasshopper 1.0.7)

# ---- group: Path Finder
gene_pool = GenePool(Decimals=0, Maximum=200, Minimum=-200, Value=[-4, -8, -20, -24, -28, -40, -36, -24, -12, 16])
surface = Surface(<surface referenced from the Rhino model>)
point = Point(Point(-413.8302722, 57.13971943, 688.2622693))
point_2 = Point(Point(-197.2370303, -948.8586214, 756.2378929))
ghpython_script = GhPythonScript(mountain=surface, start_point=point, end_point=point_2, gene=gene_pool)  # -> out, path, fitness, degree_of_slope, average_degree, min_degree, max_degree, length_of_path, annotation; inputs mountain: Surface, start_point: Point3d, end_point: Point3d, gene: list
# ---------- ghpython_script: Python ----------
import rhinoscriptsyntax as rs


class Utils:
    def generate_line(self, pt_1, pt_2):
        return rs.AddLine(pt_1, pt_2)
        
    def divide_curve(self, curve, seg_count):
        return rs.DivideCurve(curve, seg_count)
        
    def length_curve(self, curve):
        return rs.CurveLength(curve)
        
    def interpolate_curve(self, points):
        return rs.AddInterpCurve(points, degree=3, knotstyle=1)
        
    def projection_curve(self, curve, surface):
        return rs.ProjectCurveToSurface(curve, surface, [0,0,1])
        
    def surface_points(self, surface):
        return rs.SurfacePoints(surface)
        
    def move_object(self, object, translation):
        return rs.MoveObject(object, translation)
        
    def curve_pipe(self, curve, rad):
        return rs.AddPipe(curve, 0, rad)


class PathFinder:
    def __init__(self, mountain, start_point, end_point, gene):
        self.mountain = mountain
        self.start_point = start_point
        self.end_point = end_point
        self.gene = gene
        
        self.utils = Utils()
        
    def get_mountain(self):
        return self.mountain
        
    def get_start_point(self):
        return self.start_point
        
    def get_end_point(self):
        return self.end_point
        
    def get_gene(self):
        return self.gene
        
    def calculate_slope(self, pt_1, pt_2):
        x1, y1, z1 = pt_1
        x2, y2, z2 = pt_2
        distance = ((x2-x1)**2 + (y2-y1)**2) ** 0.5
        slope_degree = abs((z2-z1)/distance * 100)
        return slope_degree
        
    def calculate_min_max(self, degree_of_slope):
        return min(degree_of_slope), max(degree_of_slope)
        
    def calculate_average(self, degree_of_slope):
        return sum(degree_of_slope) / len(degree_of_slope)
        
    def limit_point(self):
        mountain_points = self.utils.surface_points(self.mountain)
        x_coordinates = []
        
        for point in mountain_points:
            x = point[0]
            if x not in x_coordinates:
                x_coordinates.append(x)
                
        min_x = min(x_coordinates)
        max_x = max(x_coordinates)
        return min_x, max_x
        
    def evaluate_fitness(self, degree_of_slope, length_of_path):
        average_degree = self.calculate_average(degree_of_slope)
        _, max_degree = self.calculate_min_max(degree_of_slope)
        return average_degree * max_degree * length_of_path
        
    def main(self):
        STRAIGHT_SEG_COUNT = 11
        PROJECTION_SEG_COUNT = 60
        MARGIN = 20
        RADIUS = 3
        
        min_x, max_x = self.limit_point()
        
        straight = self.utils.generate_line(self.start_point, self.end_point)
        divide_straight = self.utils.divide_curve(straight, STRAIGHT_SEG_COUNT)
        for i, point in enumerate(divide_straight[1:-1]):
            gene = self.get_gene()[i]
                
            translation = [gene, 0, 0]
            self.utils.move_object(point, translation)
            
            if point[0]-MARGIN < min_x:
                point[0] = min_x+MARGIN
            elif point[0]+MARGIN > max_x:
                point[0] = max_x-MARGIN
                
        interpolate_curve = self.utils.interpolate_curve(divide_straight)
        projection_curve = self.utils.projection_curve(interpolate_curve, self.get_mountain())
        
        divide_projection = self.utils.divide_curve(projection_curve, PROJECTION_SEG_COUNT)
        length_of_path = 0
        degree_of_slope = []
        path = []
        for i in range(1, len(divide_projection)):
            pt_1 = divide_projection[i-1]
            pt_2 = divide_projection[i]
            
            line = self.utils.generate_line(pt_1, pt_2)
            pipe = self.utils.curve_pipe(line, RADIUS)[0]
            path.append(pipe)
            
            line_length = self.utils.length_curve(line)
            length_of_path += line_length
            
            degree = self.calculate_slope(pt_1, pt_2)
            degree_of_slope.append(degree)
            
        fitness = self.evaluate_fitness(degree_of_slope, length_of_path)
        average_degree = self.calculate_average(degree_of_slope)
        min_degree, max_degree = self.calculate_min_max(degree_of_slope)
        annotation = "fitness: {}\naverage degree: {}\nmax degree: {}\nlength of path: {}" \
                     .format(fitness, average_degree, max_degree, length_of_path)
        
        return path, fitness, degree_of_slope, average_degree, min_degree, max_degree, length_of_path, annotation
        
if __name__ == "__main__":
    utils = Utils()
    
    translation = [0,0,0]                                                   # convert surface to guid
    mountain = utils.move_object(mountain, translation)                     # convert surface to guid
    
    pf = PathFinder(mountain, start_point, end_point, gene)
    
    path, fitness, degree_of_slope, average_degree, min_degree, max_degree, length_of_path, annotation = pf.main()
# ---------- end ghpython_script ----------
number = Number(ghpython_script.fitness)
panel = Panel(number)
panel_2 = Panel(ghpython_script.average_degree)
panel_3 = Panel(ghpython_script.max_degree)
panel_4 = Panel(ghpython_script.length_of_path)
galapagos = Galapagos(fitness=number, gene=gene_pool)

# ---- group: Topography Analysis
number_slider = Slider(20, range=0..100)
divide_domain² = DivideDomain²(Domain=surface, UCount=number_slider, VCount=number_slider)
isotrim = Isotrim(Surface=surface, Domain=divide_domain²)
area = Area(Geometry=isotrim)  # -> Area, Centroid
deconstruct = Deconstruct(Point=area.Centroid)  # -> XComponent, YComponent, ZComponent
bounds = Bounds(Numbers=deconstruct.ZComponent)
deconstruct_domain = DeconstructDomain(Domain=bounds)  # -> Start, End
gradient = Gradient(
    LowerLimit=deconstruct_domain.End,
    UpperLimit=deconstruct_domain.Start,
    Parameter=deconstruct.ZComponent,
    stops=[0.201: RGB(220, 0, 40), 0.932: RGB(17, 0, 163)])
custom_preview = CustomPreview(Geometry=isotrim, Material=gradient)

# ---- group: Annotation
unit_x = UnitX(Factor=-600)
move = Move(Geometry=point, Motion=unit_x)  # -> Geometry, Transform
rotate_plane = RotatePlane(Plane=move.Geometry, Angle=degrees(180))
rotate_plane_2 = RotatePlane(Plane=point_2, Angle=degrees(180))
rotate_plane_3 = RotatePlane(Plane=point, Angle=degrees(180))
text = Text(ghpython_script.annotation)
text_tag_3d = TextTag3D(Location=rotate_plane_3, Text="starting", Size=15, Justification=2)
text_tag_3d_2 = TextTag3D(Location=rotate_plane_2, Text="arrival", Size=15, Justification=8)
text_tag_3d_3 = TextTag3D(Location=rotate_plane, Text=text, Size=15, Justification=9)

# ----
series = Series(Start=-200, Step=1, Count=401)
bounds_2 = Bounds(Numbers=series)
remap_numbers = RemapNumbers(Value=series, Source=bounds_2, Target=Domain(0, 1))  # -> Mapped, Clipped
list_length = ListLength(List=remap_numbers.Mapped)
multiplication = Multiplication(A=remap_numbers.Mapped, B=100)
panel_5 = Panel(list_length)
panel_6 = Panel(multiplication)

# ---- group: Path Finder / Visualization
gradient_2 = Gradient(
    LowerLimit=ghpython_script.max_degree,
    UpperLimit=ghpython_script.min_degree,
    Parameter=ghpython_script.degree_of_slope,
    stops=[0.348: RGB(220, 0, 40), 1: RGB(17, 0, 163)])
custom_preview_2 = CustomPreview(Geometry=ghpython_script.path, Material=gradient_2)
