# Grasshopper definition graph_node.gh (Grasshopper 1.0.7)

connection = Panel("""1,2,3,4,5
0,2,6
0,1,4,7
0,4,7,8
0,2,3,5,6,8
0,4,6
1,4,5
2,3
3,4""")
point = Point(Point(-181.6717672, 28.63591547, 0))
ghpython_script = GhPythonScript(datas=connection, origin=point)  # -> out, nodes, circles, connections; inputs datas: list
# ---------- ghpython_script: Python ----------
import math
import random
import Rhino.Geometry as rg
import Rhino.RhinoDoc as rc
import rhinoscriptsyntax as rs
import ghpythonlib.components as gh


class Data:
    def __init__(self, datas):
        self.datas = datas
        
    def preprocessing(self):
        prep_data = []
        for data in self.datas:
            split_data = data.split(',')
            convert_data = list(map(int, split_data))
            prep_data.append(convert_data)
        return prep_data


class Node:
    def __init__(self, node):
        self.node = node
        self.connection = []
        self.depth = None
        
    def get_connection(self):
        return self.connection
        
    def get_depth(self):
        return self.depth
        
    def connect_node(self, other_node):
        self.connection.extend(other_node)
        
    def add_depth(self, depth):
        self.depth = depth

class Graph:
    def __init__(self, nodes, origin):
        self.nodes = nodes
        self.origin = origin
        
    def calculate_depth(self):
        discovered = []
        for node in self.nodes:
            print(node.get_connection())
        return
        
    def generate_polygon(self):
        size = 20
        segments = len(self.nodes)
        fillet = 0
        return gh.Polygon(rs.coerce3dpoint(self.origin), size, segments, fillet)[0]
        
    def visualization_nodes(self):
        return gh.DeconstructBrep(self.generate_polygon())[2]
        
    def visualization_circles(self):
        radius = 2
        nodes_points = self.visualization_nodes()
        return gh.Circle(nodes_points, radius)
        
    def visualization_connections(self):
        nodes_points = self.visualization_nodes()
        lines = []
        for i, node in enumerate(self.nodes):
            for c in node.get_connection():
                line = rs.AddLine(nodes_points[i], nodes_points[c])
                lines.append(line)
        return lines


if __name__ == "__main__":
    convert_data = Data(datas).preprocessing()
    node_list = []
    for i, conn in enumerate(convert_data):
        curr_node = Node(i)
        curr_node.connect_node(conn)
        node_list.append(curr_node)
        
    graph = Graph(node_list, origin)
    nodes = graph.visualization_nodes()
    circles = graph.visualization_circles()
    connections = graph.visualization_connections()
    
    
    depth = graph.calculate_depth()
# ---------- end ghpython_script ----------
point_2 = Point(ghpython_script.nodes)
circle = Circle(ghpython_script.circles)
line = Line(ghpython_script.connections)
# Mean Depth
# Max Depth
# Depth per Space
point_list = PointList(Points=point_2, Size=2)

connection_2 = Panel("""1
0,2
1,3
2,4,5
3
3,6,7
5,7
5,6,8
7""")
point_3 = Point(Point(-181.6717672, -42.11095141, 0))
ghpython_script_2 = GhPythonScript(datas=connection_2, origin=point_3)  # -> out, nodes, circles, connections; inputs datas: list
# ---------- ghpython_script_2: Python ----------
import math
import random
import Rhino.Geometry as rg
import Rhino.RhinoDoc as rc
import rhinoscriptsyntax as rs
import ghpythonlib.components as gh


class Data:
    def __init__(self, datas):
        self.datas = datas
        
    def preprocessing(self):
        prep_data = []
        for data in self.datas:
            split_data = data.split(',')
            convert_data = list(map(int, split_data))
            prep_data.append(convert_data)
        return prep_data


class Node:
    def __init__(self, node):
        self.node = node
        self.connection = []
        self.depth = 0
        
    def connect_node(self, other_node):
        self.connection.extend(other_node)
        
    def depth_node(self):
        return

class Graph:
    def __init__(self, nodes, origin):
        self.nodes = nodes
        self.origin = origin
        self.depth = 0
        
    def generate_polygon(self):
        size = 20
        segments = len(self.nodes)
        fillet = 0
        return gh.Polygon(rs.coerce3dpoint(self.origin), size, segments, fillet)[0]
        
    def visualization_nodes(self):
        return gh.DeconstructBrep(self.generate_polygon())[2]
        
    def visualization_circles(self):
        radius = 2
        nodes_points = self.visualization_nodes()
        return gh.Circle(nodes_points, radius)
        
    def visualization_connections(self):
        nodes_vis = self.visualization_nodes()
        lines = []
        for i, node in enumerate(self.nodes):
            for c in node.connection:
                line = rs.AddLine(nodes_vis[i], nodes_vis[c])
                lines.append(line)
        return lines


if __name__ == "__main__":
    convert_data = Data(datas).preprocessing()
    node_list = []
    for i, conn in enumerate(convert_data):
        curr_node = Node(i)
        curr_node.connect_node(conn)
        node_list.append(curr_node)
        
    graph = Graph(node_list, origin)
    nodes = graph.visualization_nodes()
    circles = graph.visualization_circles()
    connections = graph.visualization_connections()
    
    
    for node in node_list:
        print(node.depth_node())
# ---------- end ghpython_script_2 ----------
point_4 = Point(ghpython_script_2.nodes)
circle_2 = Circle(ghpython_script_2.circles)
line_2 = Line(ghpython_script_2.connections)
point_list_2 = PointList(Points=point_4, Size=2)

ghpython_script_3 = GhPythonScript()  # -> out, a
# ---------- ghpython_script_3: Python ----------
# Python3 Program to determine level
# of each node and print level
import Queue
 
# function to determine level of
# each node starting from start_node using BFS
def printLevels(graph, graph_length, start_node):
     
    # array to store level of each node
    level = [None] * graph_length
    marked = [False] * graph_length
 
    # create a queue
    que = Queue.Queue()
 
    # enqueue element start_node
    que.put(start_node)
 
    # initialize level of source
    # node to 0
    level[start_node] = 0
 
    # marked it as visited
    marked[start_node] = True
 
    # do until queue is empty
    while (not que.empty()):
 
        # get the first element of queue
        start_node = que.get()
 
        # traverse neighbors of node start_node
        for i in range(len(graph[start_node])):
             
            # b is neighbor of node start_node
            b = graph[start_node][i]
 
            # if b is not marked already
            if (not marked[b]):
 
                # enqueue b in queue
                que.put(b)
 
                # level of b is level of start_node + 1
                level[b] = level[start_node] + 1
 
                # mark b
                marked[b] = True
 
    # display all nodes and their levels
    print("Nodes", " ", "Level")
    for i in range(graph_length):
        print(" ",i,  " --> ", level[i])
 
# Driver Code
if __name__ == '__main__':
 
    # adjacency graph for tree
    graph = [[1,2,3,4,5],
            [0,2,6],
            [0,1,4,7],
            [0,4,7,8],
            [0,2,3,5,6,8],
            [0,4,6],
            [1,4,5],
            [2,3],
            [3,4]]
    
    graph = [[1],
            [0,2],
            [1,3],
            [2,4,5],
            [3],
            [3,6,7],
            [5,7],
            [5,6,8],
            [7]]
 
    # call levels function with source as 0
    printLevels(graph, 9, 0)
 
# This code is contributed by PranchalK
# ---------- end ghpython_script_3 ----------
ghpython_script_4 = GhPythonScript()  # -> out, a
# ---------- ghpython_script_4: Python ----------
# graph[i]는 i번째 노드와 인접한 노드 번호를 포함

#graph = {
#    0:[1,2,3,4,5],
#    1:[0,2,6],
#    2:[0,1,4,7],
#    3:[0,4,7,8],
#    4:[0,2,3,5,6,8],
#    5:[0,4,6],
#    6:[1,4,5],
#    7:[2,3],
#    8:[3,4]
#}

graph = {
    0:[1],
    1:[0,2],
    2:[1,3],
    3:[2,4,5],
    4:[3],
    5:[3,6,7],
    6:[5,7],
    7:[5,6,8],
    8:[7]
}

def dfs(graph, start_node):
    visit = list()
    stack = list()
    
    stack.append(start_node)
    while stack:
        node = stack.pop()
        if node not in visit:
            visit.append(node)
            stack.extend(graph[node])
    return visit

def bfs(graph, start_node):
     visit = list()
     queue = list()

     queue.append(start_node)
     depth = 0

     while queue:
         print(queue)
         node = queue.pop(0)
         if node not in visit:
             visit.append(node)
             queue.extend(graph[node])
             
     return visit
     
print(bfs(graph, 0))
# ---------- end ghpython_script_4 ----------
panel = Panel(ghpython_script_3.out)
