# Grasshopper definition tower_crane_layout.gh (Grasshopper 1.0.7)

point = Point([Point(47.380641, -93.92993675, 0), Point(78.20447733, -0.5216876691, 0), Point(-25.69332507, 12.72318455, 0), Point(-173.511686, -36.31673635, 0), Point(-130.5950383, -105.2598378, 0)])
point_2 = Point([Point(-65.16457828, 44.16003214, 0), Point(-72.43590306, 0.9624069951, 0), Point(-128.3584437, -109.7966134, 0), Point(135.8991132, -187.0877802, 0), Point(147.2518184, -148.2561684, 0), Point(45.82789272, 17.8030161, 0)])
polyline = PolyLine(Vertices=point_2, Closed=True)
number_slider = Slider(0.242, range=0..1)
number_slider_2 = Slider(0.394, range=0..1)

# ---- group: Environment
curve = Curve([<curve referenced from the Rhino model> x526])
curve_2 = Curve([<curve referenced from the Rhino model> x95])
curve_3 = Curve([<curve referenced from the Rhino model> x2])
curve_4 = Curve([<curve referenced from the Rhino model> x5])
ghpython_script = GhPythonScript(boundary=curve, low_mass=curve_2, middle_mass=curve_3, high_mass=curve_4)  # -> out, ground, low_masses, middle_masses, high_masses; inputs boundary: list, low_mass: list of Curve, middle_mass: list of Curve, high_mass: list of Curve
# ---------- ghpython_script: Python ----------
import math
import random
import Rhino.Geometry as rg
import Rhino.RhinoDoc as rc
import rhinoscriptsyntax as rs
import ghpythonlib.components as gh

def extrude_curve(crv, height):
    direction = rs.AddLine(rs.AddPoint(0,0,0), rs.AddPoint(0,0,height))
    mass = rs.ExtrudeCurve(crv, direction); rs.CapPlanarHoles(mass)
    return mass
    
def generate_mass(crvs, heights):
    masses = []
    for crv in crvs:
        if type(heights) != list:
            random_height = heights
        else:
            random_height = random.choice(heights)
        mass = extrude_curve(crv, random_height)
        masses.append(mass)
    return masses

if __name__ == "__main__":
    random.seed(0)
    
    low_heights = [3, 6, 9]
    middle_height = 15
    high_height = 70
    ground = extrude_curve(boundary[76], -20)
    low_masses = generate_mass(low_mass, low_heights)
    middle_masses = generate_mass(middle_mass, middle_height)
    high_masses = generate_mass(high_mass, high_height)
# ---------- end ghpython_script ----------
custom_preview = CustomPreview(Geometry=[ghpython_script.ground, curve], Material=ColourSwatch(SwatchColor=RGBA(255, 76, 60, 22)))
custom_preview_2 = CustomPreview(
    Geometry=[ghpython_script.low_masses, ghpython_script.middle_masses, ghpython_script.high_masses],
    Material=ColourSwatch(SwatchColor=RGBA(255, 26, 0, 69)))

# ---- group: Crane Layout Optimization
# Crane Specification: { Crane Radius:Crane Height } ▼
# 
# {30:25, 40:30, 50:40, 60:60, 70:65}
gene_pool = GenePool(Decimals=3, Maximum=1, Minimum=0, Value=[0.241, 0.475])
gene_pool_2 = GenePool(Decimals=3, Maximum=1, Minimum=0, Value=[0.562, 0.368])
gene_pool_3 = GenePool(Decimals=0, Maximum=7, Minimum=3, Value=[4, 7])
ghpython_script_2 = GhPythonScript(size=gene_pool_3)  # -> crane_radius_1, crane_radius_2; inputs size: list of Int32
# ---------- ghpython_script_2: Python ----------
import math
import random
import Rhino.Geometry as rg
import Rhino.RhinoDoc as rc
import rhinoscriptsyntax as rs
import ghpythonlib.components as gh

def size_scaling(x):
    return x*10
    
if __name__ == "__main__":
    crane_radius_1 = size_scaling(size[0])
    crane_radius_2 = size_scaling(size[1])
# ---------- end ghpython_script_2 ----------
curve_5 = Curve(<curve referenced from the Rhino model>)
curve_6 = Curve(<curve referenced from the Rhino model>)
curve_7 = Curve(<curve referenced from the Rhino model>)
ghpython_script_3 = GhPythonScript(
    site=curve_6,
    green_area=curve_7,
    housing_area=curve_5,
    crane_radius_1=ghpython_script_2.crane_radius_1,
    crane_radius_2=ghpython_script_2.crane_radius_2,
    crane_position_1=gene_pool,
    crane_position_2=gene_pool_2)  # -> out, site_surface, crane_towers, crane_origins, empty_site_area, evaluate_score; inputs site: Curve, green_area: Curve, housing_area: Curve, crane_radius_1: Int32, crane_position_1: list, crane_position_2: list
# ---------- ghpython_script_3: Python ----------
import math
import random
import Rhino.Geometry as rg
import Rhino.RhinoDoc as rc
import rhinoscriptsyntax as rs
import ghpythonlib.components as gh

class Point:
    def __init__(self, position):
        self.x = position[0]
        self.y = position[1]
        self.z = position[2]
        self.coord = self.coordinate_point()
        self.point = self.generate_point()
        
    def coordinate_point(self):
        return self.x, self.y, self.z
        
    def generate_point(self):
        return rs.AddPoint(self.coord[0], self.coord[1], self.coord[2])


class Circle(Point):
    def __init__(self, position, radius):
        Point.__init__(self, position)
        self.radius = radius
        
    def generate_circle(self):
        return rs.AddCircle(self.point, self.radius)


class Region:
    def __init__(self, crvs):
        self.plane = rg.Plane.WorldXY
        self.curves = self.evaluate_type(crvs)
        self.union = self.union_region()
        self.intsc = self.intersection_region()
        self.diff = self.difference_region()
        self.union_area = self.area_region(self.union)
        self.intsc_area = self.area_region(self.intsc)
        self.diff_area = self.area_region(self.diff)
        
    def evaluate_type(self, crvs):
        curves = []
        for crv in crvs:
            if type(crv) == type(rs.AddPoint(0,0,0)):
                curves.append(rs.coercecurve(crv))
            else:
                curves.append(crv)
        return curves
        
    def union_region(self):
        return gh.RegionUnion(self.curves)
        
    def intersection_region(self):
        return gh.RegionIntersection(self.curves[0], self.curves[1])
        
    def difference_region(self):
        return gh.RegionDifference(self.curves[0], self.curves[1])
        
#    def point_in_region(self, point):
#        return gh.PointInCurve(point
        
    def area_region(self, region):
        area = gh.Area(region)[0]
        if type(area) == list:
            if area.count(None) == 2:
                return 0
            elif area.count(None) == 1:
                area[area.index(None)] = 0
                return sum(area)
            else:
                return sum(area)
        else:
            if area == None:
                return 0
            return area


class Surface:
    def __init__(self, polyline):
        self.polyline = self.evaluate_type(polyline)
        self.surface = self.generate_surface()
            
    def generate_surface(self):
        return rs.AddPlanarSrf(self.polyline)[0]
        
    def evaluate_surface(self, position):
        srf_parameter = rs.SurfaceParameter(self.surface, position)
        crane_origin = rs.EvaluateSurface(self.surface, srf_parameter[0], srf_parameter[1])
        return crane_origin
        
    def evaluate_type(self, surface):
        if type(surface) != type(rs.AddPoint(0,0,0)):
            return rs.MoveObject(surface, [0,0,0])
        else:
            return surface        
            
    def area_surface(self):
        return rs.SurfaceArea(self.surface)[0]



if __name__ == "__main__":
    site_object = Surface(site)
    site_surface = site_object.generate_surface()
    site_area = site_object.area_surface()
    
    crane_positions = [crane_position_1, crane_position_2]
    crane_radius = [crane_radius_1, crane_radius_2]
    crane_spec = {30:25, 40:30, 50:40, 60:60, 70:65}
    
    crane_origins = []
    crane_towers = []
    crane_site_intscs = []
    visualization_elements = []
    for i, position in enumerate(crane_positions):
        crane_height = crane_spec[crane_radius[i]]
        crane_origin = site_object.evaluate_surface(position)
        crane_tower = Circle(crane_origin, crane_radius[i]).generate_circle()
        crane_site_intsc = Region([crane_tower, site]).intersection_region()
        
        crane_origin_vis = rs.CopyObject(crane_origin, [0,0,crane_height])
        crane_tower_vis = rs.CopyObject(crane_tower, [0,0,crane_height])
        
        crane_origins.append(crane_origin)
        crane_towers.append(crane_tower)
        crane_site_intscs.append(crane_site_intsc)
        visualization_elements.extend([crane_origin_vis, crane_tower_vis])
    
    crane_site_union = Region(crane_site_intscs).union
    crane_site_union_area = Region(crane_site_intscs).union_area
    empty_site_area = site_area - crane_site_union_area
    
    evaluate_score = []
    for crane in crane_towers:
        housing_area_intsc_crane = Region([crane, housing_area]).intsc_area
#        green_area_intsc_crane = -Region([crane, green_area]).intsc_area
        diff_area_site_crane = Region([crane_towers[0], site]).diff_area
        
#        evaluate_score.extend([housing_area_intsc_crane, green_area_intsc_crane, diff_area_site_crane])
        evaluate_score.extend([housing_area_intsc_crane, diff_area_site_crane])
        
    evaluate_score = sum(evaluate_score)
    
    print(gh.PointInCurve(crane_origins[0], site)[0])
# ---------- end ghpython_script_3 ----------
galapagos = Galapagos(fitness=number, gene=[gene_pool_3, gene_pool, gene_pool_2])

# ----
number_slider_3 = Slider(0.547, range=0..1)
number_slider_4 = Slider(0.784, range=0..1)
number_slider_5 = Slider(0.566, range=0..1)
number_slider_6 = Slider(0.56, range=0..1)
# Tower Crane Radius = 80m
curve_8 = Curve(<curve referenced from the Rhino model>)
construct_point = ConstructPoint(XCoordinate=number_slider, YCoordinate=number_slider_2, ZCoordinate=0)
construct_point_2 = ConstructPoint(XCoordinate=number_slider_4, YCoordinate=number_slider_3, ZCoordinate=0)
construct_point_3 = ConstructPoint(XCoordinate=number_slider_5, YCoordinate=number_slider_6, ZCoordinate=0)
boundary_surfaces = BoundarySurfaces(Edges=curve_8)
evaluate_surface = EvaluateSurface(Surface=reparameterize(boundary_surfaces), Point=construct_point)  # -> Point, Normal, UDirection, VDirection, Frame
evaluate_surface_2 = EvaluateSurface(Surface=reparameterize(boundary_surfaces), Point=construct_point_2)  # -> Point, Normal, UDirection, VDirection, Frame
evaluate_surface_3 = EvaluateSurface(Surface=reparameterize(boundary_surfaces), Point=construct_point_3)  # -> Point, Normal, UDirection, VDirection, Frame
point_3 = Point(evaluate_surface.Point)
point_4 = Point(evaluate_surface_2.Point)
point_5 = Point(evaluate_surface_3.Point)
circle = Circle(Plane=point_3, Radius=50)
circle_2 = Circle(Plane=point_4, Radius=50)
circle_3 = Circle(Plane=point_5, Radius=50)
number = Number(ghpython_script_3.evaluate_score)
panel = Panel([ghpython_script_3.empty_site_area, ghpython_script_3.evaluate_score])
region_intersection = RegionIntersection(CurvesA=boundary_surfaces, CurvesB=circle)
region_intersection_2 = RegionIntersection(CurvesA=boundary_surfaces, CurvesB=circle_2)
region_intersection_3 = RegionIntersection(CurvesA=boundary_surfaces, CurvesB=circle_3)
region_union = RegionUnion(Curves=[region_intersection, region_intersection_2, region_intersection_3])  # -> flatten(Result)
region_intersection_4 = RegionIntersection(CurvesA=region_intersection, CurvesB=region_intersection_2)
region_intersection_5 = RegionIntersection(CurvesA=region_intersection, CurvesB=region_intersection_3)
region_intersection_6 = RegionIntersection(CurvesA=region_intersection_2, CurvesB=region_intersection_3)
area = Area(Geometry=curve_8)  # -> Area, Centroid
area_2 = Area(Geometry=region_union)  # -> Area, Centroid
subtraction = Subtraction(A=area.Area, B=area_2.Area)
area_3 = Area(Geometry=region_intersection_4)  # -> Area, Centroid
area_4 = Area(Geometry=region_intersection_5)  # -> Area, Centroid
area_5 = Area(Geometry=region_intersection_6)  # -> Area, Centroid
galapagos_2 = Galapagos(
    fitness=number_2,
    gene=[number_slider, number_slider_2, number_slider_4, number_slider_3, number_slider_5, number_slider_6])
number_2 = Number(subtraction)
addition = Addition(A=subtraction, B=area_3.Area, C=area_4.Area, D=area_5.Area)
panel_2 = Panel(subtraction)
number_3 = Number(addition)
panel_3 = Panel(number_3)
