# Grasshopper definition voxel_tower.gh (Grasshopper 1.0.7)

brep = Brep(<brep referenced from the Rhino model>)
move = Move(Geometry=brep, Motion="-100,0,0")  # -> Geometry, Transform
ghpython_script = GhPythonScript(brep=brep)  # -> out, pattern, a, b, c; inputs brep: list of Brep
# ---------- ghpython_script: Python ----------
import math
import Rhino.Geometry as rg
import rhinoscriptsyntax as rs
import ghpythonlib.components as gh


class Point:
    def __init__(self, x, y, z):
        self.x = x
        self.y = y
        self.z = z
        
    def __getitem__(self, i):
        return self.get_coord()[i]
        
    def __repr__(self):
        return "{}".format(self.get_coord())
        
    def __add__(self, other_pt):
        x, y, z = self.get_coord()
        ox, oy, oz = other_pt.get_coord()
        return Point(x+ox, y+oy, z+oz)
        
    def __sub__(self, other_pt):
        x, y, z = self.get_coord()
        ox, oy, oz = other_pt.get_coord()
        return Point(x-ox, y-oy, z-oz)
        
    def __mul__(self, n):
        x,y,z = self.get_coord()
        return Point(x*n, y*n, z*n)
        
    def get_self_point(self):
        x, y, z = self.get_coord()
        self_pt = Point(x, y, z)
        return self_pt
        
    def get_coord(self):
        return [self.x, self.y, self.z]
        
    def distance_to(self, other_pt):
        x, y, _ = self.get_coord()
        ox, oy, _ = other_pt.get_coord()
        
        distance = ((ox-x)**2 + (oy-y)**2) ** 0.5
        return distance
        
    def point_in_polygon(self, boundary):
        if boundary[0].get_coord() != boundary[-1].get_coord():
            boundary.append(boundary[0])
        
        x, y, z = self.get_coord()
        
        pt = Point(x, y, z)
        ept = Point(10000, y, z)
        ray = Line(pt, ept)
        
        count = 0
        for i in range(len(boundary)-1):
                p1 = boundary[i]
                p2 = boundary[i+1]
                boundary_line = Line(p1, p2)
                
                ray_intsc_pt = ray.intersect_point(boundary_line) 
                if ray_intsc_pt is not None:
                    count += 1
                    
#        if count % 2 == 0:
#            return False
#                    
#        return True
        
        return count
        
    def generate_point(self):
        x, y, z = self.get_coord()
        return rg.Point3d(x, y, z)


class Line:
    def __init__(self, p1, p2):
        self.p1 = p1
        self.p2 = p2
        
    def generate_line(self):
        return rg.Line(self.p1, self.p2)
        
    def get_p1_coord(self):
        return self.p1[0], self.p1[1]
        
    def get_p2_coord(self):
        return self.p2[0], self.p2[1]
        
    def intersect_point(self, line2):
        p1 = self.get_p1_coord()
        p2 = self.get_p2_coord()
        p3 = line2.get_p1_coord()
        p4 = line2.get_p2_coord()
        
        x1, y1 = p1
        x2, y2 = p2
        x3, y3 = p3
        x4, y4 = p4
        z = 0
        
        denom = (y4-y3)*(x2-x1) - (x4-x3)*(y2-y1)
        if denom != 0:
            ua = ((x4-x3)*(y1-y3) - (y4-y3)*(x1-x3)) / denom
            ub = ((x2-x1)*(y1-y3) - (y2-y1)*(x1-x3)) / denom
            if (0 < ua < 1) and (0 < ub < 1):
                ix = x1 + ua * (x2-x1)
                iy = y1 + ua * (y2-y1)
                
                intersect_point = Point(ix, iy, z)
                return intersect_point
                
        elif denom == 0:
            ua = ((x4-x3)*(y1-y3) - (y4-y3)*(x1-x3))
            ub = ((x2-x1)*(y1-y3) - (y2-y1)*(x1-x3))
            if (0 < ua < 1) and (0 < ub < 1):
                ix = x1 + ua * (x2-x1)
                iy = y1 + ua * (y2-y1)
                
                intersect_point = Point(ix, iy, z)
                return intersect_point

class Polyline:
    def __init__(self, pts):
        self.pts = pts
        if self.pts[0] != self.pts[-1]:
            self.pts.append(self.pts[0])
        
    def __len__(self):
        polyline_pts = self.get_polyline_pts()
        return len(polyline_pts)
        
    def __getitem__(self, i):
        polyline_pts = self.get_polyline_pts()
        return polyline_pts[i]
        
    def __repr__(self):
        return "{}".format(self.get_polyline_pts())
        
    def get_polyline_pts(self):
        return self.pts
        
    def get_area(self):
        polyline_pts = self.get_polyline_pts()
        area = 0
        for i in range(len(polyline_pts)-1):
            x1, y1, _ = polyline_pts[i]
            x2, y2, _ = polyline_pts[i+1]
            
            area += x1*y2 - x2*y1
        
        return abs(area*0.5)
        
    def generate_polyline(self):
        polyline_pts = self.get_polyline_pts()
        converted_pts = [pt.generate_point() for pt in polyline_pts]
        
        return rg.PolylineCurve(converted_pts)
        
    def generate_surface(self):
        polyline = self.generate_polyline()
        surface = gh.BoundarySurfaces(polyline)
        return surface


class Rectangle:
    def __init__(self, origin, size):
        self.origin = origin
        self.size = size
        
    def __getitem__(self, i):
        rectangle_pts = self.get_rectangle_pts()
        return rectangle_pts[i]
        
    def __repr__(self):
        return "{}".format(self.get_rectangle_pts())
        
    def __add__(self, vector):
        origin = self.get_origin()
        size = self.get_size()
        
        added_rectangle = Rectangle(origin+vector, size)
        return added_rectangle
        
    def get_origin(self):
        return self.origin
        
    def get_size(self):
        return self.size
        
    def get_rectangle_pts(self):
        origin = self.get_origin()
        size = self.get_size()
        O = 0
        
        p0 = origin
        p1 = origin + Point(O, size, O)
        p2 = origin + Point(size, size, O)
        p3 = origin + Point(size, O, O)
        p4 = p0
        
        return [p0, p1, p2, p3, p4]
        
    def rotate_rectangle(self, origin):
        rectangle_pts = self.get_rectangle_pts()
        
        degree = 45
        sin45 = math.sin(math.radians(degree))
        cos45 = math.cos(math.radians(degree))
        
        rotated_rectangle_pts = []
        for pt in rectangle_pts:
            x, y, z = pt.get_coord()
            
            origin_x, origin_y, _ = origin.get_coord()

            rx = origin_x + (cos45*(x-origin_x) - sin45*(y-origin_y))
            ry = origin_y + (sin45*(x-origin_x) + cos45*(y-origin_y))
            
            rp = Point(rx, ry, z)
            rotated_rectangle_pts.append(rp)
            
        return Polyline(rotated_rectangle_pts)
        
    def generate_rectangle(self, rectangle):
        rectangle_pts = rectangle.get_rectangle_pts()
        converted_pts = [pt.generate_point() for pt in rectangle_pts]
        
        return Polyline(converted_pts).generate_polyline()


class Pattern(Rectangle):
    def __init__(self, boundary, size):
        self.boundary = boundary
        
        origin = self.get_pattern_origin()
        Rectangle.__init__(self, origin, size)
        
    def get_boundary_pts(self):
        boundary_points = self.boundary
        
        converted_boundary_points = []
        for bp in boundary_points:
            x, y, z = bp
            converted_bp = Point(x, y, z)
            converted_boundary_points.append(converted_bp)
        
        return converted_boundary_points
        
    def get_size(self):
        return self.size
        
    def get_pattern_origin(self):
        scaled_bbox = self.get_scaled_bbox()
        origin = scaled_bbox[0]
        return origin
        
    def get_scaled_bbox(self):
        boundary_pts = self.get_boundary_pts()
        zip_boundary_pts = zip(*boundary_pts)
    
        min_x, min_y = min(zip_boundary_pts[0]), min(zip_boundary_pts[1])
        max_x, max_y = max(zip_boundary_pts[0]), max(zip_boundary_pts[1])
        z = 0
        
        s = 30
        p0 = Point(min_x, min_y, z) + Point(-s, -s, z)
        p1 = Point(min_x, max_y, z) + Point(-s, +s, z)
        p2 = Point(max_x, max_y, z) + Point(+s, +s, z)
        p3 = Point(max_x, min_y, z) + Point(+s, -s, z)
        p4 = p0
        
        scaled_bbox = [p0, p1, p2, p3, p4]
        return scaled_bbox
        
    def get_scaled_bbox_size(self):
        scaled_bbox = self.get_scaled_bbox()
        width = scaled_bbox[0].distance_to(scaled_bbox[3])
        height = scaled_bbox[0].distance_to(scaled_bbox[1])
        
        return width, height
        
    def get_scaled_bbox_cpt(self):
        _, height = self.get_scaled_bbox_size()
        scaled_bbox = self.get_scaled_bbox()
        
        O = 0
        anchor = scaled_bbox[0]*0.5 + scaled_bbox[3]*0.5
        vector = Point(O, height/2, O)
        
        center_point = anchor + vector
        x, y, z = center_point
        return Point(x, y, z)
        
    def generate_pattern(self):
        z = self.get_boundary_pts()[0][2]
        origin = self.get_pattern_origin()
        origin = origin + Point(0, 0, z)
        
        size = self.get_size()
        width, height = self.get_scaled_bbox_size()
        
        height_count = int(height / size) * 2
        width_count = int(width / size)
        O = 0
        
        base_pattern = []
        all_patterns = []
        
        for i in range(height_count):
            curr_origin = origin
            
            if i == 0:
                copied_rec = Rectangle(curr_origin, size)
                base_pattern.append(copied_rec)
                
                all_patterns.append(copied_rec)
                origin = base_pattern[-1][2]*0.5 + base_pattern[-1][3]*0.5
            
            elif i % 2 != 0:
                copied_rec = Rectangle(curr_origin, size)
                base_pattern.append(copied_rec)
                
                all_patterns.append(copied_rec)
                origin = base_pattern[-2][1]
                
            else:
                copied_rec = Rectangle(curr_origin, size)
                base_pattern.append(copied_rec)
                
                all_patterns.append(copied_rec)
                origin = base_pattern[-1][2]*0.5 + base_pattern[-1][3]*0.5
                
            for j in range(2, width_count, 2):
                vector = Point(size*j, O, O)
                copied_pattern = copied_rec + vector
                
                all_patterns.append(copied_pattern)
                
        return all_patterns
        
    def rotate_pattern(self):
        rotate_origin = self.get_scaled_bbox_cpt()
        all_patterns = self.generate_pattern()
        
        rotate_patterns = []
        rp = []
        for pattern in all_patterns:
            rotate_pattern_pts = pattern.rotate_rectangle(rotate_origin)
            rotate_patterns.append(rotate_pattern_pts)
            
            rp.append(Polyline(rotate_pattern_pts).generate_polyline())
        
        return rp
        
#    def inside_pattern(self):
#        rotate_patterns = self.rotate_pattern()
#        boundary = self.get_boundary_pts()
#        
#        inside_pattern = []
#        for pattern in rotate_patterns:
#            count = 0
#            
#            for pt in pattern[:-1]:
#                check = pt.point_in_polygon(boundary)
#                
#                if check == False:
#                    count += 1
#                if count > 1:
#                    break
#            
#            if count < 2:
#                inside_pattern.append(pattern.generate_polyline())
#        
#        return inside_pattern


class Voxel:
    def __init__(self, brep, voxel_size):
        self.brep = brep
        self.voxel_size = voxel_size
        
    def get_brep(self):
        return self.brep
        
    def get_voxel_size(self):
        return self.voxel_size
        
    def get_brep_pts(self):
        brep = self.get_brep()
        brep_pts = gh.DeconstructBrep(brep)[2]
        
        converted_pts = []
        for pt in brep_pts:
            x, y, z = pt
            converted_pt = Point(x, y, z)
            converted_pts.append(converted_pt)
        
        return converted_pts
        
    def get_brep_zip_pts(self):
        brep_pts = self.get_brep_pts()
        zip_brep_pts = zip(*brep_pts)
        return zip_brep_pts
        
    def get_bbox_height(self):
        zip_brep_pts = self.get_brep_zip_pts()
        min_z, max_z = min(zip_brep_pts[2]), max(zip_brep_pts[2])
        
        height = abs(min_z - max_z)
        return height
        
    def generate_brep_bbox(self):
        zip_brep_pts = self.get_brep_zip_pts()
    
        min_x, max_x = min(zip_brep_pts[0]), max(zip_brep_pts[0])
        min_y, max_y = min(zip_brep_pts[1]), max(zip_brep_pts[1])
        min_z, max_z = min(zip_brep_pts[2]), max(zip_brep_pts[2])
        
        iteration = [min_x, min_y, min_x, max_y, max_x, max_y, max_x, min_y]
        
        bbox_top_pts = []
        bbox_bottom_pts = []
        for i in range(0, len(iteration), 2):
            bbox_top_pt = Point(iteration[i], iteration[i+1], max_z)
            bbox_bottom_pt = Point(iteration[i], iteration[i+1], min_z)
            
            bbox_top_pts.append(bbox_top_pt)
            bbox_bottom_pts.append(bbox_bottom_pt)
        
        return bbox_top_pts, bbox_bottom_pts
        
    def generate_floor_polyline(self):
        _, bbox_bottom_pts = self.generate_brep_bbox()
        selected_face = Polyline(bbox_bottom_pts).generate_surface()
        
        brep = self.get_brep()
        voxel_size = self.get_voxel_size()
        bbox_height = self.get_bbox_height()
        
        floor_polylines = []
        floor_count = int(bbox_height / voxel_size) + 1
        for i in range(floor_count):
            if i != 0:
                rs.MoveObject(selected_face, [0, 0, voxel_size])
            else:
                rs.MoveObject(selected_face, [0, 0, 0])
                
            floor = gh.BrepXBrep(selected_face, brep)[0]
            
            if floor is not None:
                if type(floor) is list:
                    for f in floor:
                        floor_polylines.append(f)
                else:
                    floor_polylines.append(floor)
            
        return floor_polylines
        
    def generate_floor_vertices(self):
        voxel_size = self.get_voxel_size()
        bbox_height = self.get_bbox_height()
        
        floor_polylines = self.generate_floor_polyline()
        floor_count = int(bbox_height / voxel_size) + 1
        floor_vertices = {i:[] for i in range(floor_count)}
        
        level = 0
        for i, floor in enumerate(floor_polylines):
            curr_vertices = rs.CurvePoints(floor)
            curr_z = round(curr_vertices[0][2], 3)
            
            if i != 0:
                if temp_z != curr_z:
                    level += 1
            
            floor_vertices[level].append(curr_vertices)
            temp_z = curr_z
        
        return floor_vertices
        
    def generate_voxel_tower(self):
        voxel_size = self.get_voxel_size()
        floor_vertices = self.generate_floor_vertices()
        
        
        
#        for i in floor_vertices:
#            for vertices in floor_vertices[i]:
#                pass
        
        return Pattern(floor_vertices[0][1], voxel_size).rotate_pattern()
        
        

if __name__ == "__main__":
    
    voxel_size = 3
    voxel = Voxel(brep, voxel_size)
    
    b = voxel.generate_voxel_tower()
# ---------- end ghpython_script ----------
panel = Panel(ghpython_script.out)
