# Grasshopper definition xmas_tree.gh (Grasshopper 1.0.7)

run = BooleanToggle(False)

# ---- group: led_lights_simulation
file_path = FilePath("C:\BACKUP\Playdata\202105_lab\02.git\toyProject\xmas_tree\01_gh_scripts\moving-rotating-rainbow.csv")
min_alpha = Slider(0, range=0..255)
timer = Timer(TimerInterval=5, Target=ghpython_script)  # disabled
ghpython_script = GhPythonScript(RUN=run, CSV=file_path, min_alpha=min_alpha)  # -> out, led_count, colors, transparencies; inputs RUN: Boolean, min_alpha: Int32
# ---------- ghpython_script: Python ----------
import Rhino.Geometry as rg
from System.Drawing import Color

csv = open(CSV, 'r')
simulation_limit = len(list(csv)) - 2
csv.close()

with open(CSV, 'r') as csv:
    if RUN == True:
        current_frame += 1
        if current_frame > simulation_limit:
            current_frame = 0
            
    else:
        current_frame = 0
    
    
    current_csv = csv.readlines()[current_frame+1].split(',')
    led_count = ( len(current_csv)-1 ) // 3
    
    colors = []
    transparencies = []
    for i in range(led_count):
        r = int( current_csv[i*3 + 1] )
        g = int( current_csv[i*3 + 2] )
        b = int( current_csv[i*3 + 3].replace('\n', '') )
        a = ( r + g + b ) / 3
        
        if a < min_alpha:
            a = min_alpha
            
        t = 1 - ( a / 255 )
        transparencies.append(t)
        
        color = Color.FromArgb(a, r, g, b)
        colors.append(color)
# ---------- end ghpython_script ----------
r_g_b_a = Panel(ghpython_script.colors)

# ---- group: points_cloud_tree
file_path_2 = FilePath("C:\BACKUP\Playdata\202105_lab\02.git\toyProject\xmas_tree\data\tree_coords.csv")
ghpython_script_2 = GhPythonScript(tree_coord=file_path_2)  # -> out, tree
# ---------- ghpython_script_2: Python ----------
import Rhino.Geometry as rg

with open(tree_coord, "r") as coords:
    tree = []
    for coord in coords.readlines()[1:]:
        c = coord.split(',')
        c[3] = c[3].replace('\n', '')
        
        id, x, y, z = list(map(float, c))
        tree_point = rg.Point3d(x, y, z)
        tree.append(tree_point)
# ---------- end ghpython_script_2 ----------

# ---- group: led_lights_visualization
size = Slider(0.02, range=0..0.1)
uv = Slider(5, range=0..10)
mesh_sphere = MeshSphere(Base=ghpython_script_2.tree, Radius=size, UCount=uv, VCount=uv)
create_material = CreateMaterial(
    Diffuse=ghpython_script.colors,
    Specular=RGB(255, 255, 255),
    Emission=RGB(0, 0, 0),
    Transparency=ghpython_script.transparencies,
    Shine=0)
scale = Scale(Geometry=mesh_sphere, Center=Point(0, 0, 0), Factor="10")  # -> Geometry, Transform
custom_preview = CustomPreview(Geometry=scale.Geometry, Material=create_material)
